# Grasshopper definition assemblages.gh (Grasshopper 0.9.76)
# plug-ins: CORE.GH, Human

squelette = Curve([<curve referenced from the Rhino model> x12])
sections = Curve([<curve referenced from the Rhino model> x2])

crv = Curve(squelette)
sections_2 = Curve(sections)
objatts = ObjectAttributes(ObjectOrAttributes=crv)  # -> Name, LayerName, LayerFullPath, Color, MaterialName, LinetypeName, GroupIndices, PlotWeight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
tsort = SortText(Keys=objatts.LayerName, Values=crv, Culture=127)  # -> Keys, Values
dcon = DeleteConsecutive(Set=tsort.Keys, Wrap=False)  # -> simplify(flatten(Set)), Count
mindex = MemberIndex(Set=dcon.Set, Member=graft(objatts.LayerName))  # -> flatten(Index), Count

resolution = Number(Slider(10, range=0..10))
epaisseurassemblage = Number(Slider(7, range=0..10))
taille_assemblage = Number(Slider(39, range=0..100))
margeassemblage = Number(Slider(2, range=0..10))
sections_3 = Curve(simplify(flatten(sections_2)))
sectionsindex = Integer(mindex.Index)
squelette_2 = Curve(crv)
num = Number(resolution)

divide = DivideCurve(Curve=squelette_2, Count=num, Kinks=False)  # -> Points, Tangents, Parameters
item = ListItem(List=sections_3, Index=sectionsindex, Wrap=True)  # -> simplify(graft(Item))
eval = EvaluateCurve(Curve=graft(squelette_2), Parameter=divide.Parameters)  # -> simplify(Point), Tangent, Angle
area = Area(Geometry=item)  # -> Area, Centroid
pl = PlaneNormal(Origin=eval.Point, ZAxis=eval.Tangent)  # -> simplify(Plane)
pl_origin = PlaneOrigin(Base=item, Origin=area.Centroid)  # -> simplify(Plane)
num_2 = Number(margeassemblage)
orient = Orient(Geometry=item, Source=pl_origin, Target=pl)  # -> Geometry, Transform
num_3 = Number(epaisseurassemblage)
offset = Offset(Curve=orient.Geometry, Distance=num_2, Plane=pl, Corners=1)  # -> simplify(Curve)
path_mapper = PathMapper(offset, source="{A;B}(i)", target="{A}(B)")
offset_2 = Offset(Curve=path_mapper, Distance=num_3, Plane=pl, Corners=1)
path_mapper_2 = PathMapper(offset, source="{A;B}(i)", target="{A}(B)")
path_mapper_3 = PathMapper(offset, source="{A;B}(i)", target="{A}(B)")
path_mapper_4 = PathMapper(offset_2, source="{A;B}(i)", target="{A}(B)")
loft = Loft(Curves=orient.Geometry, Options={Adjust=True, Closed=False, LoftEnds=0, LoftSimp=0, LoftType=0, Rebuild=10, Refit=0.01})
loft_2 = Loft(Curves=path_mapper_4, Options={Adjust=True, Closed=False, LoftEnds=0, LoftSimp=0, LoftType=0, Rebuild=10, Refit=0.01})
loft_3 = Loft(Curves=path_mapper, Options={Adjust=True, Closed=False, LoftEnds=0, LoftSimp=0, LoftType=0, Rebuild=10, Refit=0.01})
cap = CapHoles(Brep=flatten(loft_2))
cap_2 = CapHoles(Brep=flatten(loft))
cap_3 = CapHoles(Brep=flatten(loft_3))

mcx = MultipleCurves(Curves=squelette_2)  # -> Points, IndexA, IndexB, ParamA, ParamB
pt = Point(flatten(mcx.Points))
cullduppoints = RemoveDuplicatePoints(InputPoints=pt, Tolerance=0.001)  # -> OutputPoints, FirstPointIndexes
null = NullItem(Item=cullduppoints.OutputPoints)  # -> NullFlags, InvalidFlags, Description
cull = CullPattern(List=cullduppoints.OutputPoints, CullPattern=invert(null.NullFlags))
ptassemblages = Point(cull)
num_4 = Number(taille_assemblage)
sph = Sphere(Base=cull, Radius=expr("x*2", num_4))  # -> simplify(graft(Sphere))
sph_2 = Sphere(Base=ptassemblages, Radius=num_4)  # -> simplify(graft(Sphere))

interieur = Brep(cap_3)
exterieur = Brep(cap)

crv_cp = CurveClosestPoint(Point=graft(ptassemblages), Curve=squelette_2)  # -> Point, Parameter, simplify(Distance)
bool = Boolean(invert(crv_cp.Distance))
cull_2 = CullPattern(List=interieur, CullPattern=bool)  # -> simplify(List)
cull_3 = CullPattern(List=exterieur, CullPattern=bool)  # -> simplify(List)

assemblage = Brep(sph_2)
tasseauassemblage = Brep(sph)
interieur_2 = Brep(cull_2)
exterieur_2 = Brep(cull_3)

sunion = SolidUnion(Breps=interieur_2)
sunion_2 = SolidUnion(Breps=exterieur_2)
sint = SolidIntersection(BrepsA=tasseauassemblage, BrepsB=sunion)
sint_2 = SolidIntersection(BrepsA=assemblage, BrepsB=sunion_2)
mdif = MeshDifference(MeshesA=sint_2, MeshesB=sint)
